# Requirement set scooterSystemRequriments (R2022a)
Scooter requirements defined as in document Scooter requirements.docx

## 1 [#1] Turn on (Container)
Requirements linked to function Turn on

### 1.1 [#2] Scooter turn on/off
Users shall be able to turn on/off the scooter.

### 1.2 [#4] Turn on/off switch
The scooter shall have only one mechanical turn on/off switch.

### 1.3 [#5] Battery connection when turn on
The scooter shall connect the battery to the electric drive when the turn on/off button is in ON position while SOC is more than 10 %.

### 1.4 [#6] Software initialization when turn on
The scooter shall initialize all software tasks when the turn on/off button is in ON position while SOC is more than 10 %.

### 1.5 [#7] Display SOC on turn on
The scooter shall display initial SOC when the turn on/off button is in ON position while SOC is more than 10 %.

### 1.6 [#8] Turn on when SOC less than 10 %
The scooter shall display a no battery sign in the display when the SOC is less than 10 %.
Keywords: battery, SOC, turn on

## 2 [#9] Turn off (Container)
Requirements linked to turn off function.

### 2.1 [#11] Battery disconnection when turn off
The scooter shall disconnect the battery from the electric drive when the turn on/off button is in OFF position.

### 2.2 [#12] Controller data when turn off
The scooter shall remove all the data in the volatile memory of the controller.

## 3 [#10] Accelerate (Container)
Requirements linked to accelerate function

### 3.1 [#14] Mechanical throttle (Informational)
The scooter shall have a mechanical throttle.

### 3.2 [#15] Torque control
The scooter shall control motor torque depending on the level of the mechanical throttle.

### 3.3 [#17] Acceleration rate
The scooter shall accelerate from 0 to maximum speed in 6 seconds at the following conditions: maximum rider weight, 100 % SOC, tires inflated to the manufacture specifications, flat ground, maximum performance configuration.
Keywords: Acceleration, speed
Comment: Are we asking for operation at 100 % SOC? Or we prefer another level?

## 4 [#13] Brake (Container)
Requirements linked to brake function

### 4.1 [#18] Mechanical brake
The scooter shall have a mechanical brake installed in the rear wheel.

### 4.2 [#19] Deceleration rate
The scooter decelerate from maximum speed to zero in 6 seconds at the following conditions: maximum rider weight, 100 % SOC, tires inflated to the manufacture specifications, flat ground, maximum performance configuration.

### 4.3 [#20] Braking distance
The scooter shall be able to stop form 25 km/h within a maximum distance of 2 m when the mechanical brake is applied.

### 4.4 [#29] Speed display steps
The scooter shall display its actual speed in 2 km/h steps.

## 5 [#21] Ride (Container)
Requirements linked to ride function

### 5.1 [#22] Top speed
The scooter shall be able to ride at maximum top speed of 25 km/h ± 2 km/h

### 5.2 [#23] Hill climbing capability
The scooter shall be able to climb an 80 m long 10 % average grade hill in a maximum of 10 s with an average speed of 10 km/h.

### 5.3 [#24] Standard testing profile
The scooter shall be able to accelerate until maximum speed, ride 10 seconds in maximum speed, and decelerate until stop at the following conditions: maximum rider weight, fully charged, tires inflated to the manufacture specifications, flat ground, maximum performance configuration.

### 5.4 [#25] Battery range
The scooter shall have a range of at least 80 km under the following conditions: 5 % average slope hill, maximum rider weight, fully charged, tires inflated to the manufacture specifications, maximum performance configuration (no energy saving mode), maximum acceleration requested in all the accelarions. The scooter is ridden until battery dies completely.
Keywords: battery, range

## 6 [#26] Display speed (Container)
Requirements linked to display speed function

### 6.1 [#28] Speed display unit
The scooter shall display its actual speed in km/h.

### 6.2 [#64] Speed display steps
The scooter shall display its actual speed in 2 km/h steps

### 6.3 [#30] Speed measurement precission
The scooter shall measure its actual speed with a maximum error of 2% with respect to the real speed.

## 7 [#27] Display SOC (Container)
Requirements linked to SOC display

### 7.1 [#31] SOC display
The scooter shall display its actual SOC in percentage respect to its full battery state.

### 7.2 [#32] SOC display steps
The scooter shall display its actual SOC in 5 % steps.

### 7.3 [#33] SOC estimation precission
The scooter shall estimate its actual SOC with a maximum error of 5 % with respect to the real SOC.

## 8 [#34] Charge battery (Container)
Requirements linked to battery charging function

### 8.1 [#35] Battery charging power source
The scooter shall charge the battery from the utility grid.

### 8.2 [#36] Charging time
The scooter shall charge the battery from 30 % to 80 % of SOC in 2 hours.

## 9 [#37] Limit propulsion torque (Container)
Requirements related to propulsion torque limit

### 9.1 [#38] Limit torque
The scooter shall receive a limit torque flag from the user smartphone.

### 9.2 [#39] Propulsion torque limitation level
The scooter shall limit its propulsion torque to 50 % of its maximum torque when the limit torque flag is activated.

## 10 [#40] Fold scooter (Container)
Requirements linked to scooter folding

### 10.1 [#41] Fold scooter
The scooter shall be folded.

### 10.2 [#42] Folding size
Folded size shall be length 45.5 x height 46.1 x width 19.8 inches

## 11 [#43] Unfold scooter (Container)
Requirements linked to scooter unfolding

### 11.1 [#44] Scooter unfold
The scooter shall be unfolded

### 11.2 [#45] Unfolded size
Unfolded size shall be length 45.5 x height 46.1 x width 21.3 inches

## 12 [#46] Install/Remove battery (Container)
Requirements linked to battery installation and removal

### 12.1 [#61] Battery removal (Informational)
The battery shall be removed.

### 12.2 [#62] Battery replacement (Informational)
The battery shall be replaced.

### 12.3 [#63] Battery removing safety (Informational)
The battery shall include safety measures to avoid short-circuiting it while installing/removing.

## 13 [#47] Install/Remove wheels (Container)
Requirements linked to wheel installation and removal

### 13.1 [#56] Wheel removal (Informational)
Front and rear wheels shall be removed

### 13.2 [#59] Wheel replacing (Informational)
Front and rear wheel shall be replaced

## 14 [#48] Miscellaneous (Container)
Other requirements

### 14.1 [#51] Wheel diameter (Informational)
Maximum wheel diameter shall be 125 mm

### 14.2 [#50] Weight (Informational)
Maximum scooter weight shall be 20 kg ± 2 kg

### 14.3 [#52] Motor mounting (Informational)
Motor shall be embedded in the front wheel

### 14.4 [#53] Rider weight (Informational)
The rider shall weight a maximum of 100 kg

### 14.5 [#54] Operating temperature
The scooter shall be able to give rated power at an ambient temperature between -10 °C and 40 °C at the following conditions: maximum rider weight, fully charged, tires inflated to the manufacture specifications, flat ground, maximum performance configuration.